# Grasshopper definition menger-sponge.ghx (Grasshopper 1.0.7)
# Menger sponge. Native Grasshopper definition for Rhino 8.

# ---- group: Menger sponge
# Note: Menger sponge
# Iterations 0-3. Size is the outer edge.
# Centered on the world origin.
# Right-click Mesh, then Bake.
iterations = Slider(2, range=0..3)
size = Slider(10, range=0.1..100)
menger = CSharpScript(Iterations=iterations, Size=size)  # -> Mesh; inputs Iterations: Int32, Size: Double
#   port Iterations: Iteration count from 0 to 3.
#   port Size: Outer edge length.
#   port Mesh: Menger sponge mesh. Right-click and choose Bake.
# ---------- menger: C# ----------
    int n = System.Convert.ToInt32(iterations);
    double edge = System.Convert.ToDouble(size);
    if (n < 0) n = 0;
    if (n > 3) n = 3;
    if (edge < 0.0) edge = 0.0;

    mesh = BuildMengerSponge(n, edge);
# ---------- menger: C# additional code ----------
  // Menger sponge. A cell stays when, at every ternary digit, fewer than
  // two of its x/y/z digits are 1 (the open cross through each cube).
  private Mesh BuildMengerSponge(int iterations, double size)
  {
    Mesh sponge = new Mesh();
    if (size <= 0.0 || iterations < 0)
      return sponge;

    int cells = 1;
    for (int level = 0; level < iterations; level++)
      cells *= 3;

    double cell = size / (double)cells;
    double origin = -0.5 * size;

    for (int ix = 0; ix < cells; ix++)
    {
      for (int iy = 0; iy < cells; iy++)
      {
        for (int iz = 0; iz < cells; iz++)
        {
          if (!CellKept(ix, iy, iz, iterations))
            continue;

          double x = origin + ix * cell;
          double y = origin + iy * cell;
          double z = origin + iz * cell;
          AppendExposedFaces(sponge, x, y, z, cell, ix, iy, iz, cells, iterations);
        }
      }
    }

    sponge.Normals.ComputeNormals();
    sponge.Compact();
    return sponge;
  }

  private bool CellKept(int x, int y, int z, int iterations)
  {
    for (int level = 0; level < iterations; level++)
    {
      int middles = 0;
      if (x % 3 == 1) middles++;
      if (y % 3 == 1) middles++;
      if (z % 3 == 1) middles++;
      if (middles >= 2)
        return false;
      x /= 3;
      y /= 3;
      z /= 3;
    }
    return true;
  }

  private void AppendExposedFaces(Mesh sponge, double x, double y, double z, double s, int ix, int iy, int iz, int cells, int iterations)
  {
    if (!HasNeighbor(ix + 1, iy, iz, cells, iterations))
      AddQuad(sponge, x + s, y, z, x + s, y + s, z, x + s, y + s, z + s, x + s, y, z + s);
    if (!HasNeighbor(ix - 1, iy, iz, cells, iterations))
      AddQuad(sponge, x, y + s, z, x, y, z, x, y, z + s, x, y + s, z + s);
    if (!HasNeighbor(ix, iy + 1, iz, cells, iterations))
      AddQuad(sponge, x + s, y + s, z, x, y + s, z, x, y + s, z + s, x + s, y + s, z + s);
    if (!HasNeighbor(ix, iy - 1, iz, cells, iterations))
      AddQuad(sponge, x, y, z, x + s, y, z, x + s, y, z + s, x, y, z + s);
    if (!HasNeighbor(ix, iy, iz + 1, cells, iterations))
      AddQuad(sponge, x, y, z + s, x + s, y, z + s, x + s, y + s, z + s, x, y + s, z + s);
    if (!HasNeighbor(ix, iy, iz - 1, cells, iterations))
      AddQuad(sponge, x, y, z, x, y + s, z, x + s, y + s, z, x + s, y, z);
  }

  private bool HasNeighbor(int x, int y, int z, int cells, int iterations)
  {
    if (x < 0 || y < 0 || z < 0 || x >= cells || y >= cells || z >= cells)
      return false;
    return CellKept(x, y, z, iterations);
  }

  private void AddQuad(Mesh sponge, double x0, double y0, double z0, double x1, double y1, double z1, double x2, double y2, double z2, double x3, double y3, double z3)
  {
    int i = sponge.Vertices.Count;
    sponge.Vertices.Add(x0, y0, z0);
    sponge.Vertices.Add(x1, y1, z1);
    sponge.Vertices.Add(x2, y2, z2);
    sponge.Vertices.Add(x3, y3, z3);
    sponge.Faces.AddFace(i, i + 1, i + 2, i + 3);
  }
# ---------- end menger ----------
